# Dynamo graph export.S1.dyn (Dynamo 3.5.0.8297)

file_path = Filename(".\export.csv")
file_from_path = FileObject(path=file_path)
categories = Categories("OST_GenericModel")
all_elements_of_category = ElementsOfCategory(Category=categories)
id = Element.Id(element=all_elements_of_category)
type = Object.Type(object=all_elements_of_category)
getLocation = Element.GetLocation(element=all_elements_of_category)
X = Point.X(point=getLocation)
number = DoubleInput(0.305)
mul = X * number
Y = Point.Y(point=getLocation)
mul_2 = Y * number
Z = Point.Z(point=getLocation)
mul_3 = Z * number
name = Element.Name(element=all_elements_of_category)
list_create = List.Create(item0=id, item1=type, item2=mul, item3=mul_2, item4=mul_3, item5=name)
transpose = List.Transpose(lists=list_create)
string = StringInput("ElementId")
string_2 = StringInput("Type")
string_3 = StringInput("X_m")
string_4 = StringInput("Y_m")
string_5 = StringInput("Z_m")
string_6 = StringInput("ElementName")
header = List.Create(item0=string, item1=string_2, item2=string_3, item3=string_4, item4=string_5, item5=string_6)
number_2 = DoubleInput(0)
insert = List.Insert(list=transpose, element=header, index=number_2)
python_script = Python(IN[0]=insert, IN[1]=file_path)  # CPython3
# ---------- python_script.python (11 lines) ----------
import csv

data = IN[0]      # liste de lignes (header inclus)
path = IN[1]      # chemin complet vers .csv (string)

with open(path, "w", newline="", encoding="utf-8") as f:
    writer = csv.writer(f, delimiter=";")
    for row in data:
        writer.writerow(row)

OUT = path
# ----------------------------------------
