# Dynamo graph export.S2.dyn (Dynamo 3.5.0.8297)

categories = Categories("OST_GenericModel")
all_elements_of_category = ElementsOfCategory(Category=categories)
getLocation = Element.GetLocation(element=all_elements_of_category)
file_path = Filename(".\export.csv")
file_from_path = FileObject(path=file_path)
name = Element.Name(element=all_elements_of_category)
id = Element.Id(element=all_elements_of_category)
type = Object.Type(object=all_elements_of_category)
boundingBox = Element.BoundingBox(element=all_elements_of_category)

# group: BoundingBox
maxPoint = BoundingBox.MaxPoint(boundingBox=boundingBox)
minPoint = BoundingBox.MinPoint(boundingBox=boundingBox)

# group: X,Y,Z
X = Point.X(point=maxPoint)
Y = Point.Y(point=maxPoint)
Z = Point.Z(point=maxPoint)

# group: X,Y,Z
X_2 = Point.X(point=minPoint)
Y_2 = Point.Y(point=minPoint)
Z_2 = Point.Z(point=minPoint)

# group: Titre <Double-cliquer ici pour modifier le titre du groupe>
add = X + X_2
number = DoubleInput(2)
div = add / number
add_2 = Y + Y_2
div_2 = add_2 / number
add_3 = Z + Z_2
div_3 = add_3 / number
sub = X - X_2
sub_2 = Y - Y_2
sub_3 = Z - Z_2

number_2 = DoubleInput(0.305)
mul = div * number_2
mul_2 = div_2 * number_2
mul_3 = div_3 * number_2
mul_4 = sub * number_2
mul_5 = sub_2 * number_2
mul_6 = sub_3 * number_2
elementType = Element.ElementType(element=all_elements_of_category)
familyName = ElementType.FamilyName(elementType=elementType)
list_create = List.Create(item0=id, item1=type, item2=mul, item3=mul_2, item4=mul_3, item5=mul_4, item6=mul_5, item7=mul_6, item8=familyName)
transpose = List.Transpose(lists=list_create)

# group: Header_names
string = StringInput("ElementId")
string_2 = StringInput("Type")
string_3 = StringInput("CenterX_m")
string_4 = StringInput("CenterY_m")
string_5 = StringInput("CenterZ_m")
string_6 = StringInput("SizeX_m")
string_7 = StringInput("SizeY_m")
string_8 = StringInput("SizeZ_m")
string_9 = StringInput("ElementName")

header = List.Create(item0=string, item1=string_2, item2=string_3, item3=string_4, item4=string_5, item5=string_6, item6=string_7, item7=string_8, item8=string_9)
number_3 = DoubleInput(0)
insert = List.Insert(list=transpose, element=header, index=number_3)
python_script = Python(IN[0]=insert, IN[1]=file_path)  # CPython3
# ---------- python_script.python (11 lines) ----------
import csv

data = IN[0]      # liste de lignes (header inclus)
path = IN[1]      # chemin complet vers .csv (string)

with open(path, "w", newline="", encoding="utf-8") as f:
    writer = csv.writer(f, delimiter=";")
    for row in data:
        writer.writerow(row)

OUT = path
# ----------------------------------------
